# Grasshopper definition ToolTest.gh (Grasshopper 1.0.4)

pln = Plane(PlaneXY(0, 0, 0))
vec = VectorXYZ(XComponent=Slider(146, range=0..500), YComponent=Slider(218, range=0..500), ZComponent=0)  # -> Vector, Length
move = Move(Geometry=pln, Motion=vec.Vector)  # -> Geometry, Transform
rotate = Rotate(Geometry=move.Geometry, Angle=Slider(0, range=0..9), Plane=PlaneXY(0, 0, 0))  # -> Geometry, Transform
pln_2 = Plane(rotate.Geometry)
number_slider = Slider(4, range=0..12)
number_slider_2 = Slider(6, range=0..12)
python = GhPythonScript(
    layer_no=Slider(5, range=0..12),
    gap_min=Slider(4, range=0..12),
    input_plane=pln_2,
    primary_length=Slider(450, range=0..1200),
    secondary_length=Slider(960, range=0..1200),
    omnidirectional=Toggle(True),
    primary_board_width_outside=number_slider_2,
    primary_board_height_outside=number_slider,
    primary_board_width_inside=number_slider_2,
    primary_board_height_inside=number_slider,
    secondary_board_width=Slider(4, range=0..12),
    secondary_board_height=Slider(4, range=0..12),
    primary_interval=Slider(12, range=0..30),
    primary_falloff=Slider(150, range=0..300),
    primary_dedensification=Slider(3, range=0..20),
    secondary_interval=Slider(80, range=0..90),
    secondary_interval_development=Slider(0.83, range=0.3..6),
    skip_centrals=Toggle(True))  # -> out, visual; inputs layer_no: Int32, input_plane: Plane, omnidirectional: Boolean, skip_centrals: Boolean; disabled
# ---------- python: Python ----------
__author__ = "JulianKlaus"
__version__ = "2020.09.10"

import rhinoscriptsyntax as rs
from compas.geometry import Point, Box, Frame, Vector, scale_vector, normalize_vector
from CeilingCreation10 import Ceilingsystem
from compas_ghpython.artists import MeshArtist


layer_no = 5
gap_min = 4.0
primary_length = 450.0
secondary_length = 840.0
omnidirectional = True
primary_board_width_outside = 6.0
primary_board_height_outside = 4.0
primary_board_width_inside = 6.0
primary_board_height_inside = 4.0
primary_board_outside_dimensions = [primary_board_width_outside, primary_board_height_outside, primary_length]
primary_board_inside_dimensions = [primary_board_width_inside, primary_board_height_inside, primary_length]
secondary_board_width = 4.0
secondary_board_height = 4.0
secondary_board_dimensions = [secondary_board_width, secondary_board_height, secondary_length]

primary_interval = 12.0
primary_falloff = 150.0
primary_dedensification = 3.0
secondary_interval = 40.0
secondary_interval_development = .9
skip_centrals = True

primary_direction = 1
secondary_direction = 0


origin_point = input_plane[0]
vec1 = normalize_vector(input_plane[2])
vec2 = normalize_vector(input_plane[1])
origin_frame = Frame(origin_point, vec1, vec2)

myCeiling = Ceilingsystem(layer_no, gap_min, primary_length, secondary_length, omnidirectional,
                          primary_board_width_outside, primary_board_height_outside,
                          primary_board_width_inside, primary_board_height_inside,
                          secondary_board_width, secondary_board_height,
                          primary_interval, primary_falloff, primary_dedensification,
                          secondary_interval, secondary_interval_development, 
                          origin_frame, skip_centrals)

myCeiling.standard_ceiling_setup()

visual = myCeiling.grasshopper_draw()
# ---------- end python ----------
# layer_no = 5
# gap_min = 4.0
# primary_length = 450.0
# secondary_length = 840.0
# omnidirectional = True
# primary_board_width_outside = 6.0
# primary_board_height_outside = 4.0
# primary_board_width_inside = 6.0
# primary_board_height_inside = 4.0
# 
# 
# secondary_board_width = 4.0
# secondary_board_height = 4.0
# 
# 
# primary_interval = 12.0
# primary_falloff = 150.0
# primary_dedensification = 3.0
# secondary_interval = 40.0
# secondary_interval_development = .9
# skip_centrals = True
# 
# primary_direction = 1
# secondary_direction = 0
preview = CustomPreview(Geometry=python.visual, Material=ColourSwatch(SwatchColor=RGB(48, 122, 187)))
