# Grasshopper definition ToolTest4.gh (Grasshopper 1.0.4)

pln = Plane(PlaneXY(0, 0, 0))
vec = VectorXYZ(XComponent=Slider(321, range=0..500), YComponent=Slider(218, range=0..500), ZComponent=0)  # -> Vector, Length
move = Move(Geometry=pln, Motion=vec.Vector)  # -> Geometry, Transform
rotate = Rotate(Geometry=move.Geometry, Angle=Slider(0, range=0..9), Plane=PlaneXY(0, 0, 0))  # -> Geometry, Transform
pln_2 = Plane(rotate.Geometry)
primary_board_height = Slider(4, range=0..12)
primary_board_width = Slider(6, range=0..12)
clay_addon = Slider(5, range=0..12)
vertical_support_secondary = BooleanToggle(False)
vertical_support_primary = BooleanToggle(False)
omnidirectional = BooleanToggle(False)
skip_centrals = BooleanToggle(False)
advanced = BooleanToggle(False)
python = GhPythonScript(
    layer_no=Slider(5, range=1..13),
    gap_min=Slider(3, range=0..12),
    input_plane=pln_2,
    primary_length=Slider(500, range=0..1200),
    secondary_length=Slider(92, range=0..1200),
    omnidirectional=omnidirectional,
    primary_board_width_outside=primary_board_width,
    primary_board_height_outside=primary_board_height,
    primary_board_width_inside=primary_board_width,
    primary_board_height_inside=primary_board_height,
    secondary_board_width=primary_board_width,
    secondary_board_height=primary_board_height,
    primary_interval=Slider(11.1, range=0..30),
    primary_dedensification=Slider(6, range=0..20),
    secondary_interval=Slider(27.5, range=0..90),
    secondary_interval_development=Slider(1.19, range=0.3..6),
    skip_centrals=skip_centrals,
    primary_falloff=Slider(201.3, range=0..300),
    momentum_support_length=Slider(80, range=0..1200),
    shear_support_length=Slider(150, range=0..1200),
    advanced=advanced,
    vert_support_prim=vertical_support_primary,
    vert_support_sec=vertical_support_secondary,
    clay_filling_no_layers=Slider(-1, range=-1..8),
    clay_density=Slider(1900, range=0..2000),
    clay_addon=clay_addon)  # -> out, visual, total_weight, weight_per_m2, area, timber_volume, clay_volume; inputs layer_no: Int32, input_plane: Plane, omnidirectional: Boolean, skip_centrals: Boolean, advanced: Boolean, vert_support_prim: Boolean, clay_filling_no_layers: Int32, clay_density: Int32
# ---------- python: Python ----------
__author__ = "JulianKlaus"
__version__ = "2020.09.10"

import rhinoscriptsyntax as rs
import math
from compas.geometry import Point, Box, Frame, Vector, scale_vector, normalize_vector

from CeilingCreation55 import Floorslabsystem
from compas_ghpython.artists import MeshArtist



primary_board_outside_dimensions = [primary_board_width_outside, primary_board_height_outside, primary_length]
primary_board_inside_dimensions = [primary_board_width_inside, primary_board_height_inside, primary_length]
secondary_board_dimensions = [secondary_board_width, secondary_board_height, secondary_length]

if clay_filling_no_layers == -1:
    clay_filling_no_layers = None

origin_point = input_plane[0]
vec1 = normalize_vector(input_plane[2])
vec2 = normalize_vector(input_plane[1])
origin_frame = Frame(origin_point, vec1, vec2)



myFloorslab = Floorslabsystem(layer_no, gap_min, primary_length, secondary_length, omnidirectional,
                          primary_board_width_outside, primary_board_height_outside,
                          primary_board_width_inside, primary_board_height_inside,
                          secondary_board_width, secondary_board_height,
                          primary_interval, primary_falloff, primary_dedensification,
                          secondary_interval, secondary_interval_development, 
                          origin_frame, skip_centrals)

if advanced:
    myFloorslab.advanced_floorslab_setup(shear_support_length, momentum_support_length)
myFloorslab.vert_sup_setup(vert_support_prim, vert_support_sec)
myFloorslab.floorslab_creation()
myFloorslab.component_instances_export()

weights = myFloorslab.weight_calculator(clay_addon, 460, clay_density, clay_filling_no_layers)
total_weight = round(weights[0], 2)
weight_per_m2 = round(weights[1], 2)
area = round(weights[2], 2)
timber_volume = round(weights[4], 2)
clay_volume = round(weights[5], 2)



visual = myFloorslab.grasshopper_draw()
print(myFloorslab.component_instances_export)
# ---------- end python ----------
area_m2 = Panel(python.area)
clay_volume_m3 = Panel(python.clay_volume)
total_weight_kg = Panel(python.total_weight)
weight_m2 = Panel(python.weight_per_m2)
timber_volume_m3 = Panel(python.timber_volume)
# layer_no = 5
# gap_min = 4.0
# primary_length = 450.0
# secondary_length = 840.0
# omnidirectional = True
# primary_board_width_outside = 6.0
# primary_board_height_outside = 4.0
# primary_board_width_inside = 6.0
# primary_board_height_inside = 4.0
# 
# 
# secondary_board_width = 4.0
# secondary_board_height = 4.0
# 
# 
# primary_interval = 12.0
# primary_falloff = 150.0
# primary_dedensification = 3.0
# secondary_interval = 40.0
# secondary_interval_development = .9
# skip_centrals = True
# 
# primary_direction = 1
# secondary_direction = 0
preview = CustomPreview(Geometry=python.visual, Material=ColourSwatch(SwatchColor=RGB(48, 122, 187)))
