# Grasshopper definition ToolTest5.gh (Grasshopper 1.0.7)

pln = Plane(PlaneXY(0, 0, 0))
vec = VectorXYZ(XComponent=Slider(321, range=0..500), YComponent=Slider(218, range=0..500), ZComponent=0)  # -> Vector, Length
move = Move(Geometry=pln, Motion=vec.Vector)  # -> Geometry, Transform
rotate = Rotate(Geometry=move.Geometry, Angle=Slider(0, range=0..9), Plane=PlaneXY(0, 0, 0))  # -> Geometry, Transform
pln_2 = Plane(rotate.Geometry)
primary_board_height = Slider(4, range=0..12)
primary_board_width = Slider(6, range=0..12)
vertical_support_interlock = Slider(6, range=0..16)
vertical_support_width = Slider(12, range=0..16)
clay_addon = Slider(5, range=0..12)
vertical_support_secondary = BooleanToggle(True)
vertical_support_primary = BooleanToggle(True)
width_gluepath = Slider(1.51, range=0..3)
omnidirectional = BooleanToggle(False)
skip_centrals = BooleanToggle(True)
advanced = BooleanToggle(True)
glue = BooleanToggle(True)
python = GhPythonScript(
    layer_no=Slider(5, range=1..13),
    gap_min=Slider(0, range=0..12),
    input_plane=pln_2,
    primary_length=Slider(500, range=0..1200),
    secondary_length=Slider(92, range=0..1200),
    omnidirectional=omnidirectional,
    primary_board_width_outside=primary_board_width,
    primary_board_height_outside=primary_board_height,
    primary_board_width_inside=primary_board_width,
    primary_board_height_inside=primary_board_height,
    secondary_board_width=primary_board_width,
    secondary_board_height=primary_board_height,
    primary_interval=Slider(21.1, range=0..30),
    primary_dedensification=Slider(6, range=0..20),
    secondary_interval=Slider(27.5, range=0..90),
    secondary_interval_development=Slider(1.19, range=0.3..6),
    skip_centrals=skip_centrals,
    primary_falloff=Slider(201.3, range=0..300),
    momentum_support_length=Slider(80, range=0..1200),
    shear_support_length=Slider(60, range=0..1200),
    advanced=advanced,
    vert_support_prim=vertical_support_primary,
    vert_support_sec=vertical_support_secondary,
    vert_support_width=vertical_support_width,
    vert_support_interlock=vertical_support_interlock,
    clay_filling_no_layers=Slider(-1, range=-1..8),
    clay_density=Slider(1900, range=0..2000),
    clay_addon=clay_addon,
    glue=glue,
    glue_path_width=width_gluepath)  # -> out, visual, lines, total_weight, weight_per_m2, area, timber_volume, clay_volume; inputs layer_no: Int32, input_plane: Plane, omnidirectional: Boolean, skip_centrals: Boolean, advanced: Boolean, vert_support_prim: Boolean, clay_filling_no_layers: Int32, clay_density: Int32, glue: Boolean
# ---------- python: Python ----------
__author__ = "JulianKlaus"
__version__ = "2020.09.10"

import rhinoscriptsyntax as rs
import math
import Rhino.Geometry as rg
from compas.geometry import Point, Box, Frame, Vector, scale_vector, normalize_vector
from compas_ghpython.artists import MeshArtist
from assembly_information_model.assembly import Element, Assembly

from Floorslab_AIM_GH_64 import floorslab_creation, gluepoints, advanced_floorslab_setup
from compas.datastructures import Mesh
from compas_rhino.artists import MeshArtist, BoxArtist


if clay_filling_no_layers == -1:
    clay_filling_no_layers = None

origin_point = input_plane[0]
origin_vector_primary = normalize_vector(input_plane[2])
origin_vector_secondary = normalize_vector(input_plane[1])
origin_frame = Frame(origin_point, origin_vector_primary, origin_vector_secondary)
# secondary_span_interval_development: 1 = constant, <1: denser in the centre, >1: denser on the edges
# operable range approximately 0.6/6


primary_direction = 0
secondary_direction = 1

Slabassembly = Assembly()
Slabassembly.layer_no = layer_no
Slabassembly.gap_min = gap_min
Slabassembly.primary_length = primary_length
Slabassembly.secondary_length = secondary_length
Slabassembly.omnidirectional = omnidirectional
Slabassembly.primary_board_width_outside = primary_board_width_outside
Slabassembly.primary_board_height_outside = primary_board_height_outside
Slabassembly.primary_board_width_inside = primary_board_width_inside
Slabassembly.primary_board_height_inside = primary_board_height_inside
Slabassembly.primary_board_outside_dimensions = [Slabassembly.primary_board_width_outside,
                                                 Slabassembly.primary_board_height_outside, Slabassembly.primary_length]
Slabassembly.primary_board_inside_dimensions = [Slabassembly.primary_board_width_inside,
                                                Slabassembly.primary_board_height_inside, Slabassembly.primary_length]
Slabassembly.secondary_board_width = secondary_board_width
Slabassembly.secondary_board_height = secondary_board_height
Slabassembly.secondary_board_dimensions = [Slabassembly.secondary_board_width, Slabassembly.secondary_board_height,
                                           Slabassembly.secondary_length]
Slabassembly.primary_interval = primary_interval
if Slabassembly.omnidirectional:
    Slabassembly.primary_falloff = primary_falloff
    Slabassembly.primary_dedensification = primary_falloff
else:
    Slabassembly.primary_falloff = 0.0
    Slabassembly.primary_dedensification = 0
Slabassembly.secondary_interval = secondary_interval
Slabassembly.secondary_interval_development = secondary_interval_development
Slabassembly.skipping = skip_centrals
Slabassembly.primary_direction = 0
Slabassembly.secondary_direction = 1
Slabassembly.origin_fr = origin_frame
Slabassembly.origin_pt = origin_frame[0]
Slabassembly.prim_dir = origin_frame[1]
Slabassembly.sec_dir = origin_frame[2]
Slabassembly.sec_fr = Frame(Slabassembly.origin_pt, Slabassembly.sec_dir, Slabassembly.prim_dir)
Slabassembly.timberboards = []
Slabassembly.setup_done = False

Slabassembly.prim_vert_sup = vert_support_prim
Slabassembly.sec_vert_sup = vert_support_sec
Slabassembly.gluepathwidth = glue_path_width
Slabassembly.vertical_support_width = 12.0
Slabassembly.vertical_support_interlock = 8.0
Slabassembly.vert_sup_lengths = None
Slabassembly.vert_sup_gap_tolerance = 0.2
Slabassembly.vert_sup_gap_min = 0.5

# ADVANCED PARAMETERS
Slabassembly.advanced_setup = advanced
if advanced:
    advanced_floorslab_setup(Slabassembly, shear_support_length, momentum_support_length)

mySystem = floorslab_creation(Slabassembly)


def grasshopper_draw(system):
    def box_update(elmnt):
        elmnt.board_frame = Frame(elmnt.centre_point, elmnt.length_vector, elmnt.width_vector)
        elmnt.box = Box(elmnt.board_frame, elmnt.length, elmnt.width, elmnt.height)
        return elmnt.board_frame, elmnt.box

    visualisations = []
    
    board = system.network.node[1]["element"]
    
    my_box = box_update(board)[1]
    myartist = BoxArtist(my_box, color=(100,100,100))
    myartist.draw()
    visualisations = myartist
    
    """
    for brd in system.elements():
        board = brd[1]
        # visualise all the boards
        my_box = box_update(board)[1]
        mesh_box = Mesh.from_shape(my_box)
        artist = MeshArtist(mesh_box)
        
        myartist = BoxArtist(my_box, color=(100,100,100))
        myartist.draw()
        

        box_visualisation = artist.draw_mesh()
        visualisations.append(mesh_box)"""

    return visualisations
    
def gluedraw(system):
    
    def compas_to_rg(pt):
        return rg.Point3d(pt[0], pt[1], pt[2])
    
    
    visualisations = []
    for brd in system.elements():
        board = brd[1]
        gluepts = board.glue_paths        
        if len(gluepts) == 0:
            continue
        
        for path in gluepts:
            for i in range(0,len(path)-1):
                mypt = path[i]
                nextpt = path[i+1]
                myLine = rg.Line(compas_to_rg(mypt), compas_to_rg(nextpt))
                visualisations.append(myLine)

    return visualisations


visual = grasshopper_draw(mySystem)

if glue:
    mySystem = gluepoints(mySystem)
    lines = gluedraw(mySystem)
# ---------- end python ----------
geo = Geometry(python.visual)
area_m2 = Panel(python.area)
clay_volume_m3 = Panel(python.clay_volume)
total_weight_kg = Panel(python.total_weight)
weight_m2 = Panel(python.weight_per_m2)
timber_volume_m3 = Panel(python.timber_volume)
line = Line(python.lines)
preview = CustomPreview(Geometry=python.visual, Material=ColourSwatch(SwatchColor=RGB(48, 122, 187)))
len = Length(Curve=line)
ma = MassAddition(Input=len)  # -> Result, PartialResults
division = Division(A=ma.Result, B=100)
# layer_no = 5
# gap_min = 4.0
# primary_length = 450.0
# secondary_length = 840.0
# omnidirectional = True
# primary_board_width_outside = 6.0
# primary_board_height_outside = 4.0
# primary_board_width_inside = 6.0
# primary_board_height_inside = 4.0
# 
# 
# secondary_board_width = 4.0
# secondary_board_height = 4.0
# 
# 
# primary_interval = 12.0
# primary_falloff = 150.0
# primary_dedensification = 3.0
# secondary_interval = 40.0
# secondary_interval_development = .9
# skip_centrals = True
# 
# primary_direction = 1
# secondary_direction = 0
gluelinelength = Panel(division)
